# Grasshopper definition Passthrough.gh (Grasshopper 1.0.8)
# plug-ins: Passthrough

list = ValueList({"--morph ffd", "--morph identity"}, selected="--morph ffd")
# --morph ffd
# --morph identity
# --morph collision
base = Panel("uv run python scripts\run_roundtrip.py run ")
concat = Concatenate(FragmentA=base, FragmentB=list)

panel = Panel("C:\Users\nbarnes\Documents\GitHub\passthrough\exchange\return")

# ----
# PASSTHROUGH
# EXPORT SURFACE/MESH TO JSON
panel_2 = Panel("C:\Users\nbarnes\Documents\GitHub\passthrough\exchange\out")
input_surface = Geometry(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)

concat_2 = Concatenate(FragmentA=panel_2, FragmentB="payload.json", JoinSeparator="\")

number_slider = Slider(10, range=0..100)
pxexport = PassthroughExport(Surface=input_surface, UCount=24, VCount=Slider(100, range=0..100), Folder=panel_2, Write=Toggle(False))  # -> Payload, Mesh
pxtrigger = PassthroughTrigger(
    Payload=concat_2,
    Return=panel,
    Command=concat,
    WorkDir="C:\Users\nbarnes\Documents\GitHub\passthrough",
    Run=Toggle(False))  # -> Launched, Return
pximport = PassthroughImport(Return=panel, Pull=Toggle(False))  # -> Mesh, Surface, Range, CollisionPoints, FoldedFaces, DriftMax, CurvatureMax, Status
data = Data(pximport.CollisionPoints)
data_2 = Data(pximport.FoldedFaces)
data_3 = Data(pximport.Mesh)
data_4 = Data(pximport.Surface)
data_5 = Data(pxexport.Mesh)
panel_3 = Panel(pxexport.Payload)
panel_4 = Panel(pxtrigger.Launched)
panel_5 = Panel(pxtrigger.Return)
curvature_max = Panel(pximport.CurvatureMax)
driftmax = Panel(pximport.DriftMax)
panel_6 = Panel(data_3)
panel_7 = Panel(data_4)
panel_8 = Panel(data_5)
panel_9 = Panel(pximport.Status)
